# Requirement set RequirementSet (R2019a)

Attributes:
- user_Summary: value from Excel

## 1 [Pick_place!Sheet1] References to Pick_place.xlsx (Sheet1) (Container)
Imported from Microsoft Excel

### 1.1 [1] Scatola 1: stato 0,1,2 = N pezzi
user_Summary: Magazzino

### 1.2 [2] Scatola 2: stato 0,1,2,3,4 = N pezzi
user_Summary: Magazzino

### 1.3 [3] Scatola 3: stato 0,1,2,3,4,5,6 = N pezzi
user_Summary: Magazzino

### 1.4 [4] Lo stato iniziale di ciascuna scatola è quello della massima capienza pe rle scatole 1 e 2 e di vuoto per la scaola 3
user_Summary: Magazzino

### 1.5 [5] Ciascuna scatola ha un campo di availability che viene settato da un bottone esterno (scatola presente o meno) Status availability scatola: on/off pulsante
user_Summary: Magazzino

### 1.6 [6] Il prelievo ed il deposito da una scatola ordinata
user_Summary: Magazzino

### 1.7 [7] Mostra status workspace (IsReady = 0,1) pezzo 3 assemblato o meno
user_Summary: Workspace

### 1.8 [8] Check che sia disponibile il pezzo1, pezzo2 e che lo spoazio di lavoro sia libero (IsFree)
user_Summary: Workspace

### 1.9 [9] La presenza o meno di un elemento nello spazio di laoro è fornita dall'esterno con un bottone
user_Summary: Workspace

### 1.10 [10] L'utensile o l'operatore verificano la presenza dei due pezzi e può iniziare l'assemblaggio (AssemblyStatus true)
user_Summary: Workspace

### 1.11 [11] Utensile: Availability + IsReady = AssemblyStatus
user_Summary: Workspace

### 1.12 [12] Operatore: Availability + IsReady = AssemblyStatus
user_Summary: Workspace

### 1.13 [13] L'utensile o l'operatore eseguono l'assemblaggio. Se Assembly Status di operatore OR di utensile sono posti a true, l'assemblaggio può cominciare e termina dopo un certo ritardo
user_Summary: Workspace

### 1.14 [14] La macchina verifica che il pezzo sia montato (IsReady)
user_Summary: Pick&Place

### 1.15 [15] Verifica Scatola 1 Availability
user_Summary: Pick&Place

### 1.16 [16] Verifica Scatola 1 Capienza != 0
user_Summary: Pick&Place

### 1.17 [17] Preleva Scatola 1 --> Pezzo1 e decrementa la capienza ( cambia di stato la capienza)
user_Summary: Pick&Place

### 1.18 [18] Verifica Scatola 2 Availability
user_Summary: Pick&Place

### 1.19 [19] Verifica Scatola 2 != 0
user_Summary: Pick&Place

### 1.20 [20] Preleva Scatola 2 --> Pezzo2 decrementa la capienza ( cambia di stato la capienza)
user_Summary: Pick&Place

### 1.21 [21] Verifica Scatola 3 Availability
user_Summary: Pick&Place

### 1.22 [22] Verifica Scatola 3 Capienza != 6
user_Summary: Pick&Place

### 1.23 [23] Verifica della presenza del pezzo 3
user_Summary: Pick&Place

### 1.24 [24] Verifica della capienza delle tre scatole
user_Summary: Pick&Place

### 1.25 [25] Sostituzione scatola piena (se scatola 3) o sosituzione delle scatole 1 e 2 se vuote
user_Summary: Pick&Place

### 1.26 [26] Deposita Scatola 3 --> Pezzo3
user_Summary: Pick&Place

### 1.27 [27] 2 led scatola 1 0-1 per ogni posizione
user_Summary: Dashboard

### 1.28 [28] 4 led scatola 2 0-1 per ogni posizione
user_Summary: Dashboard

### 1.29 [29] 6 led scatola 3 0-1 per ogni posizione
user_Summary: Dashboard

### 1.30 [30] 1 tasto operatore/utensile
user_Summary: Dashboard