# Requirement set Copia_di_requisiti_vending_machine (R2019a)

Attributes:
- Description_5: value from Excel

## 1 [Copia di requisiti_vending_machine!Sheet1] References to Copia di requisiti_vending_machine.xlsx (Sheet1) (Container)
Read-only references to Microsoft Excel document.

### 1.1 [R1] Tipologia Bevande
la macchina eroga  bevande: caffe, the e cioccolata

### 1.2 [R2] Tipologia Pagamento
la macchina accetta pagamenti sia in contanti che con la pennetta.
Description_5: Added REQUIREMENTS

### 1.3 [R3] Opzioni Prodotti
le opzioni zuccherato niente medio molto (012) Se 0 no bacchetta. 3 size piccolo - medio - grande  . bisogna prenotare tutte le opzioni
Description_5: dopo ogni scelta display della scelta effettuata

### 1.4 [R4] Costo Prodotti
tutte le bevande con le diverse opzioni costano uguale
Description_5: gestione della modifica di una scelta. Dopo che ho effttuato una scelta e la mostro a schermo posso anche cliccare nuovamente sulla stessa cateria e modificare l'input

### 1.5 [R5] Tipologia di Inserimento
Mediante Tastierino con un display che mostra il prezzo
Description_5: gestione dell'aggiornamento del saldo della chiavetta se il credito non è sufficiente

### 1.6 [R6] Gestione Inattività
Nella fase di attesa di inserimento credito, si aspetta  per un timeout di 10 secondi, in caso negativo si torna nel caso iniziale

### 1.7 [R7] Gestione Contanti
nel caso in cui si utilizza contanti la macchina conta i contati inseriti fino ad arrivare all'importo richiesto.

### 1.8 [R8] Gestione Monete False
se la moneta inserita non viene riconosciuta la macchina restituisce la moneta

### 1.9 [R9] Gestione Chiavetta
nel caso in cui si usi la  la pennetta controlla che questa abbia abbastanza credito in caso contrario segnala la dovuta ricarica e aspetta che la pennetta sia ricaricata

### 1.10 [R10] Credito Insufficiente
nel caso in cui il credito non sia sufficiente si aspetta  per un timeout di 10 secondi, in caso negativo si torna nel caso iniziale regettando le monente inserite se presenti

### 1.11 [R11] Gestione Resto
Se inserita la chiavetta si sottrae il credito alla pennetta altrimenti da il resto in monete

### 1.12 [R12] Erogazione Prodotto
La macchina eroga il prodotto se ogni opzione bevanda è selezionata e il credito è sufficiente